test file "HEV_MODEL_TestManager"

suite "System Test Suite"
  setup callback:
    % CONFIGURE HEV Model
    HEV_Configuration = char({'Sys BD VS'});
    Select_HEV_Model_Systems('HEV_SeriesParallel', HEV_Configuration, HEV_Configs);
    Drive_Cycle_Num = 1;

  case "TC - Test Drive Cycles" [simulation]
    model HEV_SeriesParallel
    parameter set "Parameter Set 1": Drive_Cycle_Num = 1  % base workspace
    parameter set "Parameter Set 2" (off): Drive_Cycle_Num = 2  % base workspace
    parameter set "Parameter Set 3" (off): Drive_Cycle_Num = 3  % base workspace
    custom criteria:
      figure;

      Data = sltest_simout.Car.signals(4).values(:,1);
      Time = sltest_simout.Car.time;
      maxind = length(Time);
      subplot(3,1,1); plot(Time(1:maxind), Data(1:maxind)); xlabel('Time [sec]'); ylabel('Vehicle Speed [kph]');


      Data = sltest_simout.Motor.signals(2).values(:,1);
      Time = sltest_simout.Motor.time;
      maxind = length(Time);
      subplot(3,1,2); plot(Time(1:maxind), Data(1:maxind));  xlabel('Time [sec]'); ylabel('Motor Speed [RPM]');

      Data = sltest_simout.Generator.signals(2).values(:,1);
      Time = sltest_simout.Generator.time;
      maxind = length(Time);
      subplot(3,1,3); plot(Time(1:maxind), Data(1:maxind));   xlabel('Time [sec]'); ylabel('Generator Speed [RPM]');
    iteration script:
      %% Iterate over all Parameter Sets.

      % Determine the number of possible iterations
      numSteps = length(sltest_parameterSets);

      % Create each iteration
      for Drive_Cycle_Num = 1 : numSteps

          % determine sim stop time
          TESTSimStopTime = max(evalin('base',['UrbanCycle' num2str(Drive_Cycle_Num) '.time']));

          % Set up a new iteration object
          testItr = sltestiteration();

          % Set iteration settings
          % model parameters
          setModelParam(testItr, bdroot, 'StopTime', num2str(TESTSimStopTime));

          % test parameter
          setTestParam(testItr, 'ParameterSet', sltest_parameterSets{Drive_Cycle_Num});

          %iteration name
          str = sprintf('Iteration %d',Drive_Cycle_Num);

          % Register the iteration to run in this test case
          addIteration(sltest_testCase, testItr, str); % You can pass in an optional iteration name
      end

suite "Baseline Testing"
  description: This set of tests performs baseline testing on model configuration and drive cycles

  case "Drive Cycle 1 - System Level" [baseline]
    description: Drive cycle test for config: Sys BD VS
    model HEV_SeriesParallel, stop time 195
    parameter set "Parameter Set 1":
      Drive_Cycle_Num = 1  % base workspace
      Kp = HEV_Param.DCDCConv.Kp*10  % mask workspace, HEV_SeriesParallel/Electrical/System Level/DC-DC Converter
    pre-load callback:
      %Configure model
      HEV_Configuration = char({'Sys BD VS'});
      Select_HEV_Model_Systems('HEV_SeriesParallel', HEV_Configuration, HEV_Configs);

      %Turn off Simscape signal logging if it's on
      logType = get_param(bdroot, 'SimscapeLogType');
      set_param(bdroot, 'SimscapeLogType', 'None');
    cleanup callback:
      %Return Simscape logging state to original
      set_param(bdroot, 'SimscapeLogType', logType);
    baseline "System_Level_Baseline_UC1_Veh1_Batt1.mat": rel tol 0.05
      Accelerator
      Drive torque (Ref., Meas.)
      Power (Mot., Gen., Batt.)
      <Veh Spd>
      Check State Logic:1
      Check State Logic:1
      Check State Logic:1
      DC DC Temp:1
      DC/DC converter Voltage (Reference, Measured)
      Voltage (DC bus, Battery)
      Current (Motor, Battery, Generator)
      Electricals:1
      Stator current (A)
      Rotor speed (rpm)
      Electromagnetic Torque (Nm) [measured, reference]
      Stator current (A)
      Rotor speed (rpm)
      Electromagnetic Torque (Nm) [measured, reference]
      Veh Spd

  case "Drive Cycle 2 - System Level" [baseline]
    description: Drive cycle test for config: Sys BD VS
    model HEV_SeriesParallel, stop time 400
    parameter set "Parameter Set 1": Drive_Cycle_Num = 2  % base workspace
    pre-load callback:
      %Configure model
      HEV_Configuration = char({'Sys BD VS'});
      Select_HEV_Model_Systems('HEV_SeriesParallel', HEV_Configuration, HEV_Configs);


      %Turn off Simscape signal logging if it's on
      logType = get_param(bdroot, 'SimscapeLogType');
      set_param(bdroot, 'SimscapeLogType', 'None');
    cleanup callback: same code as in cleanup callback of case "Drive Cycle 1 - System Level"
    baseline "System_Level_Baseline_UC2_Veh1_Batt1.mat"
      Accelerator
      Drive torque (Ref., Meas.)
      Power (Mot., Gen., Batt.)
      <Veh Spd>
      Check State Logic:1
      Check State Logic:1
      Check State Logic:1
      DC DC Temp:1
      DC/DC converter Voltage (Reference, Measured)
      Voltage (DC bus, Battery)
      Current (Motor, Battery, Generator)
      Electricals:1
      Stator current (A)
      Rotor speed (rpm)
      Electromagnetic Torque (Nm) [measured, reference]
      Stator current (A)
      Rotor speed (rpm)
      Electromagnetic Torque (Nm) [measured, reference]
      Veh Spd

  case "Drive Cycle 3 - System Level" [baseline]
    description: Drive cycle test for config: Sys BD VS
    model HEV_SeriesParallel, stop time 400
    parameter set "Parameter Set 1": Drive_Cycle_Num = 3  % base workspace
    pre-load callback: same code as in pre-load callback of case "Drive Cycle 1 - System Level"
    cleanup callback: same code as in cleanup callback of case "Drive Cycle 1 - System Level"
    baseline "System_Level_Baseline_UC3_Veh1_Batt1.mat": rel tol 0.02
      Accelerator
      Drive torque (Ref., Meas.)
      Power (Mot., Gen., Batt.)
      <Veh Spd>
      Check State Logic:1
      Check State Logic:1
      Check State Logic:1
      DC DC Temp:1
      DC/DC converter Voltage (Reference, Measured)
      Voltage (DC bus, Battery)
      Current (Motor, Battery, Generator)
      Electricals:1
      Stator current (A)
      Rotor speed (rpm)
      Electromagnetic Torque (Nm) [measured, reference]
      Stator current (A)
      Rotor speed (rpm)
      Electromagnetic Torque (Nm) [measured, reference]
      Veh Spd